# Grasshopper definition 0Revit-to-Rhino.gh (Grasshopper 1.0.8)
# plug-ins: Rhino.Inside for Autodesk Revit

panel = Panel("""Generic Models
Lines
Windows
Walls""")
categories = QueryCategories(Type=1, IsSubcategory=False)
views = QueryViews(ViewName="{3D}", IsDependent=False, IsTemplate=False)
e_name = ElementName(Element=categories)  # -> Element, Name
python = GhPythonScript(x=e_name.Name, y=panel)  # -> out, a; inputs x: list
# ---------- python: Python ----------
for i,n in enumerate(x):
    if y in n and 'Outline' not in n:
        a = i
# ---------- end python ----------
item = ListItem(List=e_name.Element, Index=python.a, Wrap=True)
C = Categories(item)
g_elements = QueryGraphicalElements(View=views, Categories=C)
