# Grasshopper definition 0explode_view_outline.gh (Grasshopper 1.0.8)
# plug-ins: Rhino.Inside for Autodesk Revit, Jaba

# ---- group: ViewPort [View on Sheet]
tn = TypeName("Viewport")
active = ActiveView()
famfltr = FamilyFilter(Kind=3, FamilyName=tn, Inverted=False)
g_elements = QueryGraphicalElements(View=active, Filter=famfltr)
e_name = ElementName(Element=g_elements)  # -> Element, Name
python = GhPythonScript(x=e_name.Name, y="Exploded")  # -> out, a; inputs x: list
# ---------- python: Python ----------
for i,n in enumerate(x):
    if y in n and 'Outline' not in n:
        a = i
# ---------- end python ----------
item = ListItem(List=e_name.Element, Index=python.a, Wrap=True)

# ---- group: on sheet
item_2 = ListItem(List=e_name.Name, Index=python.a, Wrap=True)
pt = Point(item)

# ---- group: ViewType
views = QueryViews(IsDependent=False, IsTemplate=Toggle(True))
e_name_2 = ElementName(Element=views)  # -> Element, Name
split = TextSplit(Text=item_2, Separators="_")
item_3 = ListItem(List=split, Index=0, Wrap=True)
python_2 = GhPythonScript(x=e_name_2.Name, y="Section")  # -> out, a; inputs x: list
# ---------- python_2: Python ----------
a=[]
for i,n in enumerate(x):
    if y in n:
        a.append(i)
# ---------- end python_2 ----------
python_3 = GhPythonScript(x=item_3)  # -> a
# ---------- python_3: Python ----------
a = x.replace('Brick', '')
# ---------- end python_3 ----------
item_4 = ListItem(List=e_name_2.Name, Index=python_2.a, Wrap=True)
split_2 = TextSplit(Text=item_4, Separators="_")  # -> simplify(Result)
item_5 = ListItem(List=split_2, Index=0, Wrap=True)  # -> flatten(Item)
python_4 = GhPythonScript(x=item_5, y=python_3)  # -> out, a; inputs x: list
# ---------- python_4: Python ----------
a=[]
for i,n in enumerate(x):
    if y == n:
        a.append(i)
# ---------- end python_4 ----------
item_6 = ListItem(List=item_4, Index=python_4.a, Wrap=True)
viewtypes = QueryViewTypes(TypeName=item_6)

# ---- group: View
views_2 = QueryViews(IsDependent=False, IsTemplate=False)
e_name_3 = ElementName(Element=views_2)  # -> Element, Name
python_5 = GhPythonScript(x=e_name_3.Name, y=item_2)  # -> out, a; inputs x: list
# ---------- python_5: Python ----------
for i,n in enumerate(x):
    if y == n:
        a = i
# ---------- end python_5 ----------
item_7 = ListItem(List=e_name_3.Element, Index=python_5.a, Wrap=True)

# ---- group: Whole domunet elements
e_name_4 = ElementName(Element=views_2)  # -> Element, Name
python_6 = GhPythonScript(x=e_name_4.Name, y="{3D}")  # -> out, a; inputs x: list; same code as python_5
item_8 = ListItem(List=views_2, Index=python_6.a, Wrap=True)
g_elements_2 = QueryGraphicalElements(View=item_8)

# ---- group: in 3D
pln = Plane(item_7)
box = Box(item_7)

# ----
viewtype = ViewType(viewtypes)

# ---- group: generic models
python_7 = GhPythonScript()  # -> a
# ---------- python_7: Python ----------
import clr

# Add reference to RevitAPI
clr.AddReference('RevitAPI')
import Autodesk
from Autodesk.Revit.DB import *

# Add reference to RhinoInside
clr.AddReference('RhinoInside.Revit')
from RhinoInside.Revit import Revit

# Get the active Revit application
uiapp = Revit.ActiveUIApplication

# Get all elements of category 'OST_GenericModel'
collector = FilteredElementCollector(uiapp.ActiveUIDocument.Document)
elements = collector.OfCategory(BuiltInCategory.OST_GenericModel).ToElements()

# Output the elements
a = elements
# ---------- end python_7 ----------
item_9 = ListItem(List=python_7, Index=0, Wrap=True)
category = Category(item_9)

# ---- group: displacement set
python_8 = GhPythonScript()  # -> a
# ---------- python_8: Python ----------
import clr

# Add reference to RevitAPI
clr.AddReference('RevitAPI')
import Autodesk
from Autodesk.Revit.DB import *

# Add reference to RhinoInside
clr.AddReference('RhinoInside.Revit')
from RhinoInside.Revit import Revit

# Get the active Revit application
uiapp = Revit.ActiveUIApplication

# Get all elements of category 'OST_DisplacementElements'
collector = FilteredElementCollector(uiapp.ActiveUIDocument.Document)
elements = collector.OfCategory(BuiltInCategory.OST_DisplacementElements).ToElements()

# Output the elements
a = elements
# ---------- end python_8 ----------
item_10 = ListItem(List=python_8, Index=0, Wrap=True)
category_2 = Category(item_10)

# ---- group: get exploded view elements / shape
# Generic Models
category_3 = Category(category)
g_elements_3 = QueryGraphicalElements(View=item, Categories=category_3)

# ---- group: get exploded view elements / displacement set
# Displacement Set
category_4 = Category(category_2)
g_elements_4 = QueryGraphicalElements(View=item, Categories=category_4)

# ---- group: get exploded view elements / get element category (Revit Instance Element -> Revit Category: Revit Displacement Element)
item_11 = ListItem(List=g_elements_4, Index=19, Wrap=True)
python_9 = GhPythonScript(E=item_11)  # -> out, a
# ---------- python_9: Python ----------
import clr

# Add references to RevitAPI and RevitAPIUI
clr.AddReference('RevitAPI')
clr.AddReference('RevitAPIUI')

# Import necessary classes from Revit API
from RhinoInside.Revit import Revit
from Autodesk.Revit.DB import FilteredElementCollector, BuiltInCategory
from Autodesk.Revit import DB

# Access the active document object
doc = Revit.ActiveDBDocument

print E.Category

a = E.Category#.GetType()
# ---------- end python_9 ----------

# ---- group: get exploded view elements / get elements in displacement set
python_10 = GhPythonScript(D=g_elements_4)  # -> out, ids, E
# ---------- python_10: Python ----------
import clr

# Add references to RevitAPI and RevitAPIUI
clr.AddReference('RevitAPI')
clr.AddReference('RevitAPIUI')

# Import necessary classes from Revit API
from RhinoInside.Revit import Revit
from Autodesk.Revit.DB import FilteredElementCollector, BuiltInCategory, DisplacementElement
from Autodesk.Revit import DB

# Import GeometryDecoder class from RhinoInside.Revit.Convert.Geometry
from RhinoInside.Revit.Convert.Geometry import GeometryDecoder

# Access the active document object
doc = Revit.ActiveDBDocument

displaced_element_ids = D.GetDisplacedElementIds()

ids = [doc.GetElement(id) for id in displaced_element_ids]

# Convert Revit elements to Rhino geometries
E = []
for elem in ids:
    geo_elem = elem.get_Geometry(DB.Options())
    for geo_obj in geo_elem:
        if isinstance(geo_obj, DB.Solid):
            E.append(GeometryDecoder.ToBrep(geo_obj))
# ---------- end python_10 ----------

# ---- group: get exploded view elements
geo = Geometry(g_elements_3)
geometry = ElementGeometry(Elements=geo, Exclude=flatten(python_10.ids), DetailLevel=3)  # -> Elements, flatten(Geometry), Categories
geometry_2 = ElementGeometry(Elements=python_10.ids, DetailLevel=3)
brep = Brep(simplify(python_10.E))

# ---- group: get exploded view elements / find objects
box_2 = Box(simplify(graft(g_elements_4)))
bbox = BoundingBox(Content=brep, Plane=PlaneXY(0, 0, 0), UnionBox=True)  # -> Box, Box_2
area = Area(Geometry=bbox.Box)  # -> Area, Centroid
area_2 = Area(Geometry=box_2)  # -> Area, Centroid

# ---- group: get exploded view elements / move geo towards displacement
ln = Line(StartPoint=area.Centroid, EndPoint=area_2.Centroid)
move = Move(Geometry=brep, Motion=ln)  # -> flatten(Geometry), Transform

# ---- group: <Wide Lines>
line_styles = QueryLineStyles()
e_name_5 = ElementName(Element=line_styles)  # -> Element, Name
python_11 = GhPythonScript(x=e_name_5.Name, y="<Wide Lines>")  # -> out, a; inputs x: list; same code as python
item_12 = ListItem(List=e_name_5.Element, Index=python_11.a, Wrap=True)

# ---- group: create silhouette
clean = CleanTree(RemoveNulls=True, RemoveInvalid=True, RemoveEmpty=False, Tree=move.Geometry)
projector = Projector(ViewDirection=pln, Geometry=clean, TargetPlane=pln)  # -> ProjectedContours, ProjectedSilhouettes

# ----
concat = Concatenate(FragmentA=item_2, FragmentB="_Outline")

# ---- group: create silhouette / line type
# <Wide Lines>
e_name_6 = ElementName(Element=item_12)  # -> Element, Name
panel = Panel(e_name_6.Name)
line_styles_2 = QueryLineStyles(Name=e_name_6.Name)

# ---- group: create view
panel_2 = Panel(concat)
sectionview = AddSectionView(Frame=box, Name=panel_2, Type=viewtype, TrackingMode=2)
cropregn = ViewCropRegion(View=sectionview, CropRegionVisible=Toggle(False))  # -> View, CropView, CropRegionVisible, CropRegion

# ---- group: create silhouette
explode = Explode(Curve=projector.ProjectedSilhouettes, Recursive=True)  # -> Segments, Vertices
d_line = AddDetailLine(View=sectionview, Curve=explode.Segments, TrackingMode=2)
line_style = LineStyle(line_styles_2)
linestyle = CurveLineStyle(Element=d_line, LineStyle=line_style)  # -> Element, LineStyle
clean_2 = CleanTree(RemoveNulls=True, RemoveInvalid=True, RemoveEmpty=True, Tree=linestyle.Element)  # -> flatten(Tree)

# ---- group: hide other objects
element = Element(flatten(sectionview))
element_2 = Element(flatten(g_elements_2))
eg_overrides = ElementGraphicOverrides(View=element, Element=element_2, Hidden=Toggle(True), Overrides=Toggle(True))  # -> View, Element, Hidden, Overrides

# ---- group: create view (continued)
viewport = AddViewport(Sheet=active, View=eg_overrides.View, Point=pt, TrackingMode=2)

# ----
clean_3 = CleanTree(RemoveNulls=True, RemoveInvalid=True, RemoveEmpty=True, Tree=viewport)  # -> flatten(Tree)

element_3 = Element(clean_3)
view = View(sectionview)
curve = CurveElement(clean_2)
item_13 = ListItem(List=curve, Index=0, Wrap=True)
python_12 = GhPythonScript(x=element_3)  # -> a
# ---------- python_12: Python ----------
if x: a = True
else: a = False
# ---------- end python_12 ----------
python_13 = GhPythonScript(x=item_13)  # -> a; same code as python_12
python_14 = GhPythonScript(x=view)  # -> a; same code as python_12
and = GateAnd(A=python_13, B=python_12, C=python_14)
release = ReleaseElement(Elements=flatten([curve, element_3, view]), Released=and)  # -> Elements, Released
