# Grasshopper definition 0reset_sheet_parameters.gh (Grasshopper 1.0.8)
# plug-ins: Rhino.Inside for Autodesk Revit

sheets = QuerySheets(Placeholder=False, AppearsInSheetList=[True, False], Assembly=null)  # -> flatten(Sheets)
param = ElementParameter(Element=sheets, Parameter="Geo", Value="0")  # -> Element, Parameter, Value
panel = Panel(param.Value)
